# Dynamo graph PipeConflict_CivilEnvoy.dyn (Dynamo 2.5.1.7586)
# packages: Civil3DToolkit 1.1.13

current = Autodesk.AutoCAD.DynamoNodes.Document.Current()

# group: Get all gravity pipes in drawing
pipeNetworks = PipeNetworks(document=current)
getPipesStructures = Autodesk.Civil.DynamoNodes.PipeNetworks.PipeNetwork.GetPipesStructures(pipeNetwork=pipeNetworks)
flatten = List.Flatten(list=getPipesStructures.Pipes)
curve = Autodesk.Civil.DynamoNodes.PipeNetworks.Pipe.Curve(pipe=flatten)
XY = Plane.XY()
pullOntoPlane = Curve.PullOntoPlane(curve=curve, plane=XY)

# group: Get all pressure pipes in drawing
pressurePipeNetworks = PressurePipeNetworks(document=current)
getPipesFittings = Autodesk.Civil.DynamoNodes.PressurePipeNetworks.PressurePipeNetwork.GetPipesFittings(pressurePipeNetwork=pressurePipeNetworks)
flatten_2 = List.Flatten(list=getPipesFittings.PressurePipes)
curve_2 = Autodesk.Civil.DynamoNodes.PressurePipeNetworks.PressurePipe.Curve(pressurePipe=flatten_2)
XY_2 = Plane.XY()
pullOntoPlane_2 = Curve.PullOntoPlane(curve=curve_2, plane=XY_2)

join = List.Join(list0=pullOntoPlane, list1=pullOntoPlane_2)

# group: Find the 2D crossing points of all the pipes
intersectAll = Geometry.IntersectAll(geometry=join, others=join, lacing=CrossProduct)
boolean = BoolSelector(false)
clean = List.Clean(list=intersectAll@L3, preserveIndices=boolean)
flatten_3 = List.Flatten(list=clean@L3)
string_from_object = FromObject(obj=flatten_3)
code_block = CodeBlock { "Line"; }
contains = String.Contains(str=string_from_object, searchFor=code_block)
filterByBoolMask = List.FilterByBoolMask(list=flatten_3, mask=contains)

# group: Filter out start and end points/ Filter out Nurbs (pressure); Arcs; Ellipse / Find intersection points
startPoint = Curve.StartPoint(curve=join)
isAlmostEqualTo = Geometry.IsAlmostEqualTo(geometry=filterByBoolMask.out, other=startPoint)
endPoint = Curve.EndPoint(curve=join)
isAlmostEqualTo_2 = Geometry.IsAlmostEqualTo(geometry=filterByBoolMask.out, other=endPoint)
or_ = isAlmostEqualTo || isAlmostEqualTo_2
filterByBoolMask_2 = List.FilterByBoolMask(list=filterByBoolMask.out, mask=or_)
flatten_4 = List.Flatten(list=filterByBoolMask_2.out)
string_from_object_2 = FromObject(obj=flatten_4)
code_block_2 = CodeBlock { "Nurbs"; }
contains_2 = String.Contains(str=string_from_object_2, searchFor=code_block_2)
filterByBoolMask_3 = List.FilterByBoolMask(list=flatten_4, mask=contains_2)
flatten_5 = List.Flatten(list=filterByBoolMask_3.out)
string_from_object_3 = FromObject(obj=flatten_5)
code_block_3 = CodeBlock { "Ellipse"; }
contains_3 = String.Contains(str=string_from_object_3, searchFor=code_block_3)
filterByBoolMask_4 = List.FilterByBoolMask(list=flatten_5, mask=contains_3)
flatten_6 = List.Flatten(list=filterByBoolMask_4.out)
string_from_object_4 = FromObject(obj=flatten_6)
code_block_4 = CodeBlock { "Arc"; }
contains_4 = String.Contains(str=string_from_object_4, searchFor=code_block_4)
filterByBoolMask_5 = List.FilterByBoolMask(list=flatten_6, mask=contains_4)
pruneDuplicates = Point.PruneDuplicates(points=filterByBoolMask_5.out)

object_identity_crossingpoints = Object.Identity(obj=pruneDuplicates)
object_identity_crossingpoints_2 = Object.Identity(obj=object_identity_crossingpoints)

# group: INPUT
marker_radius = DoubleInput(3)  # graph input

byCenterPointRadius = Sphere.ByCenterPointRadius(centerPoint=object_identity_crossingpoints_2, radius=marker_radius)

# group: Combine pipes (pressure and gravity)
join_2 = List.Join(list0=flatten, list1=flatten_2)

object_identity_pipe_list = Object.Identity(obj=join_2)
identity = Object.Identity(obj=join)
doesIntersect = Geometry.DoesIntersect(geometry=pruneDuplicates, other=identity, lacing=CrossProduct)
filterByBoolMask_6 = List.FilterByBoolMask(list=object_identity_pipe_list, mask=doesIntersect@L2)

# group: Get items (labels and solids) for the first point of the pipe
firstItem = List.FirstItem(list=filterByBoolMask_6.in@L2)
string_from_object_5 = FromObject(obj=firstItem)
code_block_5 = CodeBlock { "Pressure"; }
contains_5 = String.Contains(str=string_from_object_5, searchFor=code_block_5)
object_identity_alignments = Object.Identity(obj=contains_5)
filterByBoolMask_7 = List.FilterByBoolMask(list=firstItem, mask=contains_5)
solid = Autodesk.Civil.DynamoNodes.PressurePipeNetworks.PressurePipe.Solid(pressurePipe=filterByBoolMask_7.in)
solid_2 = Autodesk.Civil.DynamoNodes.PipeNetworks.Pipe.Solid(pipe=filterByBoolMask_7.out)
python_script = Python(IN[0]=object_identity_alignments, IN[1]=solid, IN[2]=solid_2)
# ---------- python_script.python (18 lines) ----------
lst_IsPressure = IN[0]
lst_Pressure = IN[1]
lst_Gravity = IN[2]

lst_Out = []

int_pres = 0
int_grav = 0

for i in lst_IsPressure:
	if i: #pressure node found
		lst_Out.append(lst_Pressure[int_pres])
		int_pres += 1
	else: #gravity node found
		lst_Out.append(lst_Gravity[int_grav])
		int_grav += 1

OUT = lst_Out
# ----------------------------------------
pipeNetworkName = Autodesk.Civil.DynamoNodes.PressurePipeNetworks.PressurePipe.PipeNetworkName(pressurePipe=filterByBoolMask_7.in)
pipeNetworkName_2 = Autodesk.Civil.DynamoNodes.PipeNetworks.Pipe.PipeNetworkName(pipe=filterByBoolMask_7.out)
python_script_2 = Python(IN[0]=object_identity_alignments, IN[1]=pipeNetworkName, IN[2]=pipeNetworkName_2)  # same code as python_script
name = Autodesk.Civil.DynamoNodes.PressurePipeNetworks.PressurePipe.Name(pressurePipe=filterByBoolMask_7.in)
name_2 = Autodesk.Civil.DynamoNodes.PipeNetworks.Pipe.Name(pipe=filterByBoolMask_7.out)
python_script_3 = Python(IN[0]=object_identity_alignments, IN[1]=name, IN[2]=name_2)  # same code as python_script

# group: Get items (labels and solids) for the second point of the pipe
lastItem = List.LastItem(list=filterByBoolMask_6.in@L2)
string_from_object_6 = FromObject(obj=lastItem)
code_block_6 = CodeBlock { "Pressure"; }
contains_6 = String.Contains(str=string_from_object_6, searchFor=code_block_6)
object_identity_alignments_2 = Object.Identity(obj=contains_6)
filterByBoolMask_8 = List.FilterByBoolMask(list=lastItem, mask=contains_6)
solid_3 = Autodesk.Civil.DynamoNodes.PressurePipeNetworks.PressurePipe.Solid(pressurePipe=filterByBoolMask_8.in)
solid_4 = Autodesk.Civil.DynamoNodes.PipeNetworks.Pipe.Solid(pipe=filterByBoolMask_8.out)
python_script_4 = Python(IN[0]=object_identity_alignments_2, IN[1]=solid_3, IN[2]=solid_4)  # same code as python_script
pipeNetworkName_3 = Autodesk.Civil.DynamoNodes.PressurePipeNetworks.PressurePipe.PipeNetworkName(pressurePipe=filterByBoolMask_8.in)
pipeNetworkName_4 = Autodesk.Civil.DynamoNodes.PipeNetworks.Pipe.PipeNetworkName(pipe=filterByBoolMask_8.out)
python_script_5 = Python(IN[0]=object_identity_alignments_2, IN[1]=pipeNetworkName_3, IN[2]=pipeNetworkName_4)  # same code as python_script
name_3 = Autodesk.Civil.DynamoNodes.PressurePipeNetworks.PressurePipe.Name(pressurePipe=filterByBoolMask_8.in)
name_4 = Autodesk.Civil.DynamoNodes.PipeNetworks.Pipe.Name(pipe=filterByBoolMask_8.out)
python_script_6 = Python(IN[0]=object_identity_alignments_2, IN[1]=name_3, IN[2]=name_4)  # same code as python_script

# group: Clearance between the two crossing pipes
distanceTo = Geometry.DistanceTo(geometry=python_script, other=python_script_4)

# group: INPUT
minimum_vertical_clearance = DoubleInput(2)  # graph input

# group: Set marker on layers based on user's minimum clearance
ge = distanceTo >= minimum_vertical_clearance
code_block_7 = CodeBlock { "Pipe-Conflict--Clear"; }
code_block_8 = CodeBlock { "Pipe-Conflict--Clash"; }
if_ = If(test=ge, true=code_block_7, false=code_block_8)
color_palette = ColorPalette({R: 255, G: 0, B: 0, A: 255})
byNameColor = Autodesk.AutoCAD.DynamoNodes.LayerExtensions.ByNameColor(name=code_block_8, color=color_palette)
color_palette_2 = ColorPalette({R: 0, G: 223, B: 21, A: 255})
byNameColor_2 = Autodesk.AutoCAD.DynamoNodes.LayerExtensions.ByNameColor(name=code_block_7, color=color_palette_2)

# group: Set marker (sphere) at each crossing point
current_2 = Autodesk.AutoCAD.DynamoNodes.Document.Current()
modelSpace = Autodesk.AutoCAD.DynamoNodes.Document.ModelSpace(document=current_2)
byGeometry = Autodesk.AutoCAD.DynamoNodes.Object.ByGeometry(geometry=byCenterPointRadius, layer=if_, block=modelSpace)

object_identity_crossingpoints_3 = Object.Identity(obj=object_identity_crossingpoints_2)

# group: INPUT
crossing_name_prefix = StringInput("Crossing")  # graph input

# group: ID tag for each crossing
code_block_9 = CodeBlock { 1; }
count = List.Count(list=pruneDuplicates)
sequence = Sequence(start=code_block_9, amount=count)
code_block_10 = CodeBlock(num=sequence, pre=crossing_name_prefix) { num<10?pre+"-0"+num:pre+"-"+num; }

string_from_object_7 = FromObject(obj=distanceTo)
python_script_7 = Python(IN[0]=string_from_object_7)
# ---------- python_script_7.python (11 lines) ----------
lst_values = IN[0]
lst_revised = []

for i in lst_values:
	str_wholenum = i.split('.')[0]
	str_dec = i.split('.')[1]
	str_dec = str_dec[:2]
	str_revised = str_wholenum + '.' + str_dec
	lst_revised.append(str_revised)
	
OUT = lst_revised
# ----------------------------------------

# group: Get all the alignments in the drawing
alignments = Alignments(document=current)

# group: Get alginment stationing for all the crossing points
object_identity_alignments_3 = Object.Identity(obj=alignments)
object_identity_alignments_4 = Object.Identity(obj=object_identity_alignments_3)

layer = Autodesk.AutoCAD.DynamoNodes.Object.Layer(object=object_identity_alignments_3)

# group (continued): Get alginment stationing for all the crossing points
getGeometry = Autodesk.Civil.DynamoNodes.AlignmentExtensions.GetGeometry(alignment=object_identity_alignments_3, layer=layer)
byJoinedCurves = PolyCurve.ByJoinedCurves(curves=getGeometry)
intersectAll_2 = Geometry.IntersectAll(geometry=object_identity_crossingpoints, others=byJoinedCurves, lacing=CrossProduct)
python_script_8 = Python(IN[0]=intersectAll_2, IN[1]=object_identity_alignments_3)
# ---------- python_script_8.python (17 lines) ----------
lst_pnts = IN[0]
lst_alignName = IN[1]

lst_strOut = []
lst_bIsValid = []

int_pnt = len(lst_pnts)
int_alignName = len(lst_alignName)

for x in range(len(lst_pnts)):
	lst_bIsValid = []
	for y in range(len(lst_alignName)):
		if (lst_pnts[x][y]):
			#point is found
			lst_strOut.append(x)

OUT = lst_strOut
# ----------------------------------------
python_script_9 = Python(IN[0]=intersectAll_2, IN[1]=object_identity_alignments_4)
# ---------- python_script_9.python (17 lines) ----------
lst_pnts = IN[0]
lst_alignName = IN[1]

lst_strOut = []
lst_bIsValid = []

int_pnt = len(lst_pnts)
int_alignName = len(lst_alignName)

for x in range(len(lst_pnts)):
	lst_bIsValid = []
	for y in range(len(lst_alignName)):
		if (lst_pnts[x][y]):
			#point is found
			lst_strOut.append(lst_alignName[y])

OUT = lst_strOut
# ----------------------------------------
name_5 = Autodesk.Civil.DynamoNodes.CivilObject.Name(civilObject=python_script_9)
flatten_7 = List.Flatten(list=intersectAll_2)
stationOffsetByPoint = Autodesk.Civil.DynamoNodes.Alignment.StationOffsetByPoint(alignment=python_script_9, point=flatten_7, lacing=Shortest)
stationFormatting = Autodesk.Civil.DynamoNodes.AlignmentExtensions.StationFormatting(station=stationOffsetByPoint.Station)
python_script_10 = Python(IN[0]=name_5, IN[1]=stationFormatting)
# ---------- python_script_10.python (11 lines) ----------
lst_alignName = IN[0]
lst_sta = IN[1]

lst_strOut = []
lst_bIsValid = []

for x in range(len(lst_alignName)):
	strOut = lst_alignName[x] + ' ' + lst_sta[x]
	lst_strOut.append(strOut)

OUT = lst_strOut
# ----------------------------------------
python_script_11 = Python(IN[0]=object_identity_crossingpoints, IN[1]=python_script_8, IN[2]=python_script_10)
# ---------- python_script_11.python (27 lines) ----------
lst_crossingPnts = IN[0]
lst_matchIndex = IN[1]
lst_label = IN[2]

lst_strOut = []

for x in range(len(lst_crossingPnts)):
	b_IsFound = False
	str_label = ''
	for i in range(len(lst_matchIndex)):
		if int(lst_matchIndex[i]) == x:
			if not b_IsFound:
				#First alignment point found
				str_label = lst_label[i]
				b_IsFound = True
			else:
				#additional point found
				str_label += '\n'
				str_label += "                       " 
				str_label += lst_label[i]
	
	if b_IsFound: #data was found
		lst_strOut.append(str_label)
	else:
		lst_strOut.append('None')

OUT = lst_strOut
# ----------------------------------------

object_identity_crossingpoints_4 = Object.Identity(obj=python_script_11)
code_block_11 = CodeBlock(str_node=code_block_10, separation=python_script_7, str_pipe1network=python_script_2, str_pipe1name=python_script_3, str_pipe2network=python_script_5, str_pipe2name=python_script_6, str_alignment=object_identity_crossingpoints_4)
# ---------- code_block_11.designscript (7 lines) ----------
"ID: "+str_node+"\n"+
"   Separation: "+separation+"\n"+
"   Network(1): "+str_pipe1network + ": " +
str_pipe1name+"\n"+
"   Network(2): "+str_pipe2network + ": " +
str_pipe2name+"\n"+
"   Alignments: " + str_alignment;
# ----------------------------------------

# group: INPUT
marker_text_height = DoubleInput(0.5)  # graph input

# group: Text at each marker location
byPointTextRotation = Autodesk.AutoCAD.DynamoNodes.Temp.MText.ByPointTextRotation(location=object_identity_crossingpoints_3, text=code_block_11, layer=if_, height=marker_text_height)

# group: Pipe_Conflict.dyn Created by Andy Carter, PE - 2020.11.03 Purpose: This script places a marker and callout on the crossing of pipes (both gravity and pressure) for a Civil3D drawing. This script will color code the created markers based on the user inputed 'minimum clearance'. If the crossing pipes are closer than the 'minimum clearance' a red marker will be placed. Otherwise, a green marker is placed. If the pipes are on alignments, the alignment name and crossing station is provided in the crossing label's text. Notes: 1) This Packages requires one add-in to function. "Civil3DToolkit" Version 1.1.13 was used to create this routine. 2) It is recommended that the script be used in 'Manual' Mode only. 3) If 'Automatic' mode is selected, then it is recommeded that no pipes be created while this model is active. Creation of a new pipe will likely cause a crash. 4) This script was inspired by previous work from Zachri Jensen per a post on the DynamoBIM forum. Thank you greatly! Questions: Email: civileng127@hotmail.com https://civilenvoy.blogspot.com/ YouTube: Search for Civil Envoy
code_block_12 = CodeBlock {  }
code_block_13 = CodeBlock {  }
